# Grasshopper definition 190309_Serialization_Example_0.gh (Grasshopper 1.0.7)

mesh = Mesh(null)
mesh_2 = Mesh([<mesh referenced from the Rhino model> x11])
merge = Merge(Data1=mesh_2, Data2=mesh)
mesh_3 = Mesh(merge)
lng = ListLength(List=mesh_3)
int = Integer(-2)
series = Series(Start=0, Step=int, Count=lng)
vec = VectorXYZ(XComponent=series, YComponent=0, ZComponent=0)  # -> Vector, Length
move = Move(Geometry=mesh_3, Motion=vec.Vector)  # -> Geometry, Transform
yz = YZPlane(Origin=Point(0, 0, 0))
mirror = Mirror(Geometry=move.Geometry, Plane=yz)  # -> Geometry, Transform
xy = XYPlane(Origin=Point(0, 0, 0))
mirror_2 = Mirror(Geometry=mirror.Geometry, Plane=xy)  # -> Geometry, Transform

# ---- group: Deserialize Graph
c_script = CSharpScript(path="C:\Users\David\Desktop\graph_0")  # -> out, adjacency, degree, positions; inputs path: String
# ---------- c_script: C# usings ----------
using System.Linq;

using System.IO;
using System.Runtime.Serialization.Formatters.Binary;
# ---------- c_script: C# ----------
    var obj = DeserializeBinary(path);
    var data = (Tuple<int[,], float[]>) obj;

    var adj = data.Item1;
    var adjList = new List<int>();

    for(int i = 0; i < adj.GetLength(0); i++)
    {
      for(int j = 0; j < adj.GetLength(1); j++)
        adjList.Add(adj[i, j]);
    }

    adjacency = adjList;
    degree = adj.GetLength(1);
    
    positions = data.Item2;
# ---------- c_script: C# additional code ----------
  /// <summary>
  /// Binary deserialization
  /// </summary>
  /// <param name="path"></param>
  /// <returns></returns>
  public static object DeserializeBinary(string path)
  {
    using (Stream stream = new FileStream(path, FileMode.Open, FileAccess.Read, FileShare.Read))
    {
      var formatter = new BinaryFormatter();
      return formatter.Deserialize(stream);
    }
  }



  /*

  private IEnumerable<T> AsFlat<T>(T[,] source)
  {
    var m = source.GetLength(0);
    var n = source.GetLength(1);

    for(int i = 0; i < m; i++)
    {
    for (int j = 0; j < n; j++)
      //yield return source[i, j];
    }
  }

*/
# ---------- end c_script ----------

# ----
mesh_4 = Mesh(mirror_2.Geometry)

# ---- group: Deserialize Tile Model
c_script_2 = CSharpScript(path="C:\Users\David\Desktop\model_0")  # -> out, result; inputs path: String
# ---------- c_script_2: C# usings ----------
using System.IO;
using System.Runtime.Serialization.Formatters.Binary;
# ---------- c_script_2: C# ----------
    result = DeserializeBinary(path);
# ---------- c_script_2: C# additional code ----------
  /// <summary>
  /// Binary deserialization
  /// </summary>
  /// <param name="path"></param>
  /// <returns></returns>
  public static object DeserializeBinary(string path)
  {
    using (Stream stream = new FileStream(path, FileMode.Open, FileAccess.Read, FileShare.Read))
    {
      var formatter = new BinaryFormatter();
      return formatter.Deserialize(stream);
    }
  }
# ---------- end c_script_2 ----------

# ----
mesh_5 = Mesh(mesh_4)
partition = PartitionList(List=c_script.adjacency, Size=c_script.degree)
num2pt = NumbersToPoints(Numbers=c_script.positions, Mask="XZY")
item = ListItem(List=mesh_5, Index=c_script_2.result, Wrap=True)
move_2 = Move(Geometry=item, Motion=num2pt)  # -> Geometry, Transform
